# Grasshopper definition Octree.gh (Grasshopper 1.0.7)
# plug-ins: BH.UI.Grasshopper, FalseStartToggle

toggle = FalseStartToggle(True)
# NEW FILE
st7newfile = St7NewFile(
    FileName="TestPoints_octree2_on.ST7",
    FileDir="C:\Users\dmitry.zelenkin\Desktop\STRAND7_TEMP",
    Active=toggle,
    Component="{ .St7NewFile")
st7unitenum = St7UnitEnum({"N_mm": 0, "kN_m": 1}, selected="N_mm", Component="BH.oM.Adapter.Strand7.St7UnitEnum", Selection=0)
st7units = St7Units(Active=st7newfile, St7UnitEnum=st7unitenum, Component="{ .St7Units")

toggle_2 = FalseStartToggle(True)
# ADAPTER
strand7adapter = Strand7Adapter(Initialise=toggle_2, Tolerance=0.1, Component="{ ..ctor")
adapter_strand7 = BHoMAdapter(
    strand7adapter,
    ObjectType="{ \"_t\" : \"System.Type\", \"Name\" : \"System.Object, mscorlib, Version=4.0.0.0, Culture=neutral, PublicKeyToken=b77a5c561934e089\" }",
    m_ForcePreview=False,
    m_MaxItemsPreview=10000)

rectangle = Rectangle(Plane=PlaneXY(0, 0, 0), XSize="200000", YSize="200000", Radius=0)  # -> Rectangle, Length
# 40 000 points
pop2d = Populate2D(Region=rectangle.Rectangle, Count="1000", Seed=1)
Z = UnitZ(Factor="5000")
arrlinear = LinearArray(Geometry=pop2d, Direction=Z, Count=Slider(40, range=10..100))  # -> Geometry, Transform
flip = FlipMatrix(Data=arrlinear.Geometry)

node = Node(Coordinates=flatten(flip), FreedomeCase="1", Component="{ .Node")

tstat = TreeStatistics(Tree=flip)  # -> Paths, Length, Count
series = Series(Start=0, Step=1, Count=10)
lng = ListLength(List=node)

adapter_strand7_2 = BHoMAdapter(
    adapter_strand7,
    ObjectType="{ \"_t\" : \"System.Type\", \"Name\" : \"System.Object, mscorlib, Version=4.0.0.0, Culture=neutral, PublicKeyToken=b77a5c561934e089\" }",
    m_ForcePreview=False,
    m_MaxItemsPreview=10000)
# PUSH
push = Push(
    Adapter=adapter_strand7_2,
    Objects=node,
    PushType="{ \"_t\" : \"System.Enum\", \"TypeName\" : { \"_t\" : \"System.Type\", \"Name\" : \"BH.oM.Adapter.PushType\" }, \"Value\" : \"AdapterDefault\" }",
    Active=st7units,
    Component="{ .Push")  # -> Objects, flatten(Success)

item = ListItem(List=tstat.Paths, Index=series, Wrap=True)
panel = Panel(lng)
pinconstraint6dof = PinConstraint6DOF(Name="Pin", Component="{ .PinConstraint6DOF")
branch = TreeBranch(Tree=flip, Path=item, MaintainPaths=True)

node_2 = Node(Coordinates=flatten(branch), FreedomeCase="1", Support=pinconstraint6dof, Component="{ .Node")

lng_2 = ListLength(List=node_2)

adapter_strand7_3 = BHoMAdapter(
    adapter_strand7,
    ObjectType="{ \"_t\" : \"System.Type\", \"Name\" : \"System.Object, mscorlib, Version=4.0.0.0, Culture=neutral, PublicKeyToken=b77a5c561934e089\" }",
    m_ForcePreview=False,
    m_MaxItemsPreview=10000)
push_2 = Push(
    Adapter=adapter_strand7_3,
    Objects=node_2,
    PushType="{ \"_t\" : \"System.Enum\", \"TypeName\" : { \"_t\" : \"System.Type\", \"Name\" : \"BH.oM.Adapter.PushType\" }, \"Value\" : \"AdapterDefault\" }",
    Active=push.Success,
    Component="{ .Push")  # -> Objects, flatten(Success)

panel_2 = Panel(lng_2)
createtype = CreateType(Component="BH.oM.Structure.Elements.Node")
adapter_strand7_4 = BHoMAdapter(
    adapter_strand7,
    ObjectType="{ \"_t\" : \"System.Type\", \"Name\" : \"System.Object, mscorlib, Version=4.0.0.0, Culture=neutral, PublicKeyToken=b77a5c561934e089\" }",
    m_ForcePreview=False,
    m_MaxItemsPreview=10000)
pull = Pull(
    Adapter=adapter_strand7_4,
    Request=createtype,
    PullType="{ \"_t\" : \"System.Enum\", \"TypeName\" : { \"_t\" : \"System.Type\", \"Name\" : \"BH.oM.Adapter.PullType\" }, \"Value\" : \"AdapterDefault\" }",
    Active=push_2.Success,
    Component="{ .Pull")
lng_3 = ListLength(List=pull)
panel_3 = Panel(lng_3)
st7savefile = St7SaveFile(Active=False, Component="{ .St7SaveFile")
st7closefile = St7CloseFile(Active=st7savefile, Component="{ .St7CloseFile")
